# Grasshopper definition 3DSlicer-GcodeGenerator.gh (Grasshopper 1.0.8)
# plug-ins: PTComponentLibrary, Pancake

height = Slider(1.5, range=0..10)

# ---- group: Create Closed Cylinder
radius = Slider(10, range=1..20)
build_plate_base_point = Slider(10, range=0..10)
unit_z = UnitZ(Factor=height)
# [TODO]: Create Test Cylinder and Move to center of Bed
circle = Circle(Plane=PlaneXY(0, 0, 0), Radius=radius)
construct_point = ConstructPoint(XCoordinate=build_plate_base_point, YCoordinate=build_plate_base_point, ZCoordinate=0)
extrude = Extrude(Base=circle, Direction=unit_z)
move = Move(Geometry=extrude, Motion=construct_point)  # -> Geometry, Transform
cap_holes = CapHoles(Brep=move.Geometry)
closed_cylinder = Brep(cap_holes)

# ---- group: Contour
layer_height = Slider(0.3, range=0..1)
unit_z_2 = UnitZ(Factor=1)
# [TODO]: Create Contours / Perimeters)
construct_point_2 = ConstructPoint(XCoordinate=0, YCoordinate=0, ZCoordinate=0)
contour = Contour(Shape=closed_cylinder, Point=construct_point_2, Direction=unit_z_2, Distance=layer_height)

# ----
area = Area(Geometry=contour)  # -> Area, Centroid
panel = Panel(contour)
param_viewer = ParamViewer(contour)
boundary_surfaces = BoundarySurfaces(Edges=contour)
deconstruct = Deconstruct(Point=area.Centroid)  # -> XComponent, YComponent, ZComponent
panel_2 = Panel(area.Centroid)

bounding_box = BoundingBox(Content=boundary_surfaces, Plane=PlaneXY(0, 0, 0))  # -> Box, Box_2
deconstruct_box = DeconstructBox(Box=bounding_box.Box)  # -> Plane, X, Y, Z
# [TODO]: Create Infill Patterns
x_max_and_min = DeconstructDomain(XDomain=deconstruct_box.X)  # -> Start, XMax
y_max_and_min = DeconstructDomain(YDomain=deconstruct_box.Y)  # -> Start, YMax
extrusion_width = Slider(0.48, range=0..1)
subtraction = Subtraction(A=y_max_and_min.YMax, B=y_max_and_min.Start)
subtraction_2 = Subtraction(XMax=x_max_and_min.XMax, XMin=x_max_and_min.Start)
divide_x_height_extrusion_width = Division(XHeight=subtraction_2, ExtrusionWidth=extrusion_width)
division = Division(YHeight=subtraction, ExtrusionWidth=extrusion_width)
construct_domain = ConstructDomain(DomainStart=y_max_and_min.Start, DomainEnd=y_max_and_min.YMax)
construct_domain_2 = ConstructDomain(DomainStart=x_max_and_min.Start, DomainEnd=x_max_and_min.XMax)
range = Range(Domain=construct_domain_2, Steps=divide_x_height_extrusion_width)
range_2 = Range(Domain=construct_domain, Steps=division)
construct_point_3 = ConstructPoint(XCoordinate=range, YCoordinate=y_max_and_min.YMax, ZCoordinate=deconstruct.ZComponent)
construct_point_4 = ConstructPoint(XCoordinate=range, YCoordinate=y_max_and_min.Start, ZCoordinate=deconstruct.ZComponent)
line = Line(StartPoint=construct_point_4, EndPoint=construct_point_3)

panel_3 = Panel(deconstruct_box.Z)
panel_4 = Panel(deconstruct_box.Y)
boundary_surfaces_2 = BoundarySurfaces(Edges=contour)
panel_5 = Panel(construct_point_4)
panel_6 = Panel(construct_point_3)

# ---- group: Example of a line for testing
# [TODO]: Use lines for testing gcode generation then replace with line segments from slicing
number_slider = Slider(5, range=-10..30)
construct_point_5 = ConstructPoint(XCoordinate=number_slider, YCoordinate=Slider(1, range=-10..30), ZCoordinate=Slider(0, range=-10..30))
construct_point_6 = ConstructPoint(XCoordinate=Slider(30, range=-10..30), YCoordinate=Slider(1, range=-10..30), ZCoordinate=Slider(0, range=-10..30))
line_2 = Line(StartPoint=construct_point_5, EndPoint=construct_point_6)

# ---- group: A second line for testing
construct_point_7 = ConstructPoint(XCoordinate=Slider(10, range=-10..30), YCoordinate=Slider(10, range=-10..30), ZCoordinate=Slider(1, range=-10..30))
construct_point_8 = ConstructPoint(XCoordinate=Slider(10, range=-10..30), YCoordinate=Slider(20, range=-10..30), ZCoordinate=Slider(1, range=-10..30))
line_3 = Line(StartPoint=construct_point_7, EndPoint=construct_point_8)

# ----
end_gcode_do_not_edit = Panel("""; ##### WARNING: DO NOT EDIT THE END GCODE! ######
; END Gcode 
M204 S1000 
M107 
;TYPE:Custom 
; Filament-specific end gcode 
G1 Z180 F720 ; Move print head further up 
G1 X0 Y200 F3600 ; park 
M73 P97 R0
M73 Q97 S0
G4 ; wait
M221 S100 ; reset flow
M900 K0 ; reset LA
M104 S0 ; turn off temperature
M140 S0 ; turn off heatbed
M107 ; turn off fan
M84 ; disable motors
M73 P100 R0 ; print progress done
M73 Q100 S0 ; print progress done""")
start_gcode_do_not_edit = Panel("""; #### WARNING: DO NOT EDIT THE START GCODE! #####
;START GCODE
M73 P0 R2; Initial progress
M73 Q0 S2; Initial progress
M201 X1000 Y1000 Z200 E5000 ; sets maximum accelerations mm/sec^2
M203 X200 Y200 Z12 E120 ; sets maximum feedrates mm / sec
M204 S1250 T1250 ; sets acceleration (S) and retract acceleration (R) mm/sec^2
M205 X8.00 Y8.00 Z0.40 E4.50 ; sets the jerk limits mm/sec
M205 S0 T0 ; sets the minimum extruding and travel feed rate mm/sec
;TYPE: "Custom" v20250307a
M862.3 P "MK3S" ; printer model check
M862.1 P0.4 ; nozzle diameter check
M115 U3.14.0 ; tell printer latest fw version
G90 ; use absolute coordinates
M83 ; extruder relative mode
M104 S215 ; set extruder temp
M140 S60 ; set bed temp
M190 S60 ; wait for bed temp
M109 S215 ; wait for extruder temp
G28 W ; home all without mesh bed level
G80 X112.257 Y92.2571 W25.4859 H25.4859 ; mesh bed levelling
G1 Z0.2 F720
G1 Y-3 F1000 ; go outside print area
G92 E0
G1 X60 E9 F1000 ; intro line
G1 X100 E12.5 F1000 ; intro line
M73 P2 R2 ; progress
M73 Q2 S2 ; progress
G92 E0
M221 S95
; Don't change E values below. Excessive value can damage the printer.
M907 E538 ; set extruder motor current
G21 ; set units to millimeters
G90 ; use absolute coordinates
M83 ; use relative distances for extrusion
M900 K0.05 ; Filament gcode LA 1.5
M900 K30 ; Filament gcode LA 1.0
M107""")
# [TODO]: Initialize Input Parameters
line_4 = Line([line_2, line_3])
layer_change_feed_rate = Slider(720, range=0..1000)
extrusion_feed_rate = Slider(600, range=0..1000)
travel_feed_rate = Panel("1200")
travel_feed_rate_2 = Slider(1200, range=0..10000)
extrusion_width_2 = Slider(0.48, range=0..1)
nozzle_diameter = Slider(0.4, range=0..1)
filament_diameter = Slider(1.75, range=0..10)
layer_height_2 = Slider(0.3, range=0..1)
true_only_button = TrueOnlyButton(LastSaveLocalization="neutral,N")

brep_line = BrepLine(Brep=boundary_surfaces_2, Line=line, LimitToFirst=False)  # -> Curves, Points
distance_length_mm = Slider(0.1, range=0..0.1)
merge = Merge(Data1=boundary_surfaces_2, Data2=brep_line.Curves)

panel_7 = Panel(brep_line.Curves)
# [TODO]: Combine Perimeters and Infill
param_viewer_2 = ParamViewer(brep_line.Curves)
# [TODO]: Create Line Segments from Perimeters and Infill
trim_tree = TrimTree(Tree=merge, Depth=1)

divide_distance = DivideDistance(Curve=trim_tree, Distance=distance_length_mm, AddEnd=True)

tolerance_mm = Slider(0.01, range=0..0.01)
polyline = PolyLine(Vertices=divide_distance, Closed=False)
simplify_curve = SimplifyCurve(Curve=polyline, Tolerance=tolerance_mm)  # -> Curve, Simplified
explode = Explode(Curve=simplify_curve.Curve, Recursive=True)  # -> Segments, Vertices

# ----
# [TODO]: Implement the gcode generation algorithm in Python
# NOTE THAT THIS GCODE OUTPUT ASSUMES:
# - A PRUSA MK3S+ as the Printer
# - PLA Material
# - Extrusion Temperature: 215C
# - Heated Bed Temperature: 60C
python_3_script_generate_gcode = Python3Script(
    lines=flatten(explode.Segments),
    nozzle_diameter=nozzle_diameter,
    filament_diameter=filament_diameter,
    layer_height=layer_height_2,
    extrusion_width=extrusion_width_2,
    travel_feed_rate=travel_feed_rate_2,
    layer_change_feed_rate=layer_change_feed_rate,
    extrusion_feed_rate=extrusion_feed_rate,
    start_gcode_lines=start_gcode_do_not_edit,
    end_gcode_lines=end_gcode_do_not_edit)  # -> out, gcode_output; inputs lines: list of Line, nozzle_diameter: Double, filament_diameter: Double, layer_height: Double, extrusion_width: Double, travel_feed_rate: Double, layer_change_feed_rate: Double, extrusion_feed_rate: Double, start_gcode_lines: list of String, end_gcode_lines: list of String
# ---------- python_3_script_generate_gcode: Python ----------
"""
    This file contains parameters, helpers, and setup to 
    create a basic gcode generation algorithm from line segments.
    
    The main 
    
    Inputs:
        lines: the line segments to be converted into gcode commands for extrusion 
        nozzle_diameter: the diameter of the 3D printer's nozzle
        filament_diameter: the diameter of the 3d printing filament
        layer_height: the height of each layer in the print
        extrusion_width: the width of the extruded line from the printer
        travel_feed_rate: the speed at which the extruder moves in X and Y
        layer_change_feed_rate: the speed at which teh extruder moves when 
            changing layers in the Z direction
        extrusion_feed_rate: the speed at which the extruder move when extruding

    Output:
        gcode_output: a string with gcode commands separate by new-lines"""

__author__ = "mrivera-cu"

import rhinoscriptsyntax as rs

import math


########## CONSTANTS BELOW ###############

# GCODE COMMANDS
COMMAND_MOVE = "G1"

# GCODE PARAM NAMES
PARAM_X = "X"
PARAM_Y = "Y"
PARAM_Z = "Z"
PARAM_E = "E"
PARAM_F = "F"

# Separates commands
COMMAND_DELIMITER = "\n"

# Precision for converting floats to strings
E_VALUE_PRECISION = 5
XYZ_VALUE_PRECISION = 3

# Float equality precision
FLOAT_EQUALITY_PRECISION = 5

# Converts a float (f) to a string with some precision of decimal places
# For example: 
# Input: f=0.1234, precision=3 
# Output: "0.123"
def float_to_string(f, precision=XYZ_VALUE_PRECISION): 
    f = float(f)
    str_format = "{value:." + str(precision) +"f}"
    return str_format.format(value=f)
    
# Helper to convert the E value to the proper precision
def e_value_to_string(e):
    return float_to_string(e, E_VALUE_PRECISION)

# Helper to convert the XYZ value to the proper precision
def xyz_value_to_string(e):
    return float_to_string(e, XYZ_VALUE_PRECISION)

#########################################################################

# Helper function to compare floats in grasshopper/python due to float precision errors
def are_floats_equal(f1, f2, epsilon=10**(-FLOAT_EQUALITY_PRECISION)):
    f1 *= 10**FLOAT_EQUALITY_PRECISION
    f2 *= 10**FLOAT_EQUALITY_PRECISION
    return math.fabs(f2 - f1) <= epsilon
    
# Helper function to compare if two points are equal (have the same coordinates)
# by handling float precision comparisons
def is_same_pt(ptA, ptB):
    return are_floats_equal(ptA[0], ptB[0]) and are_floats_equal(ptA[1], ptB[1]) and are_floats_equal(ptA[2], ptB[2])
     
     
########################################################################
# creates a string consisting of a G1 move command and 
# any associated parameters compares if the current postiion != next position then append the new coordinate onto the string
# ??? why doesn't this have an E-value. Only a T/F should_extrude ???
def gcode_move(current_pos, next_pos, feed_rate=None, should_extrude=False):
    # Start with "G1" as command

    move_command_str = COMMAND_MOVE
    
    # Compare X positions
    if (not are_floats_equal(current_pos[0],next_pos[0])):
        # we have a different x position so add it as a parameter to the command
        x_value = float_to_string(next_pos[0], precision=XYZ_VALUE_PRECISION)
        # Add X<x_value> to move string, e.g., X100.00
        move_command_str += " " + PARAM_X + x_value
    
    # Compare Y positions
    if (not are_floats_equal(current_pos[1], next_pos[1])):
        # we have a different y position so add the new position as a parameter
        y_value = float_to_string(next_pos[1], precision=XYZ_VALUE_PRECISION)
        # Add Y<y_value> to move string, e.g., Y100.00
        move_command_str += " " + PARAM_Y + y_value
    
    # Compare Z position
    if (not are_floats_equal(current_pos[2], next_pos[2])):
        # we have a different z position so add the new position as a parameter
        z_value = float_to_string(next_pos[2], precision=XYZ_VALUE_PRECISION)
        # Add Z<z_value> to move string, e.g., Z100.00
        move_command_str += " " + PARAM_Z + z_value
    
    # [TODO]: handle "should_extrude" == true by determining the proper amount to
    # extrude using the capsule model, then append the E parameter and value
    # to the move command.
    # NOTE: YOUR FLOAT PRECISION MUST MATCH E_VALUE_PRECISION
    
     # Evaluate if we should extrude
     # ??? Did I use the should_extrude condition correctly??
    if should_extrude:
        # if we should extrude, then calculate the extrusion amount using the capsule model
        # ???: How do we know when extrude is True?
        # first calculate the 3D distance = the square root of: (x2 - x1)^2 + (y2 - y1)^2 + (z2 - z1)^2
        distance_3D = math.sqrt(((next_pos[0] - current_pos[0])**2) + ((next_pos[1] - current_pos[1])**2) + ((next_pos[2] - current_pos[2])**2))
        # volume_out = area_out * distance_3D
        # and area_out = [h * (w-h)] + [PI * (h/2)^2]
        area_out = (layer_height * (extrusion_width - layer_height)) + (math.pi * ((layer_height/2)**2))
        volume_out = area_out * distance_3D
        # since we know that volume_out = volume_in
        # and volume_in = area_in * e_value
        # then volume_out = area_in * e_value
        # that means that e_value = volume_out / area_in
        # We already have volume_out so let's calculate area_in which is a circle in shape
        # the area of a circle is PI * r^2
        area_in = math.pi * ((filament_diameter/2)**2)
        e_value = float_to_string((volume_out / area_in), precision=E_VALUE_PRECISION)
        # then append the E parameter and value to the move comment (with E_VALUE_PRECISION)
        move_command_str += " " + PARAM_E + e_value
        print("Calculated e-value: " + e_value)
        
    
    # See if we have a feedrate to use, and handle it differently than other 
    # parameters as it is an integer value
    if (feed_rate is not None):
        # feed rate is an int
        feed_rate_value = round(feed_rate)
        # Add F<feed_rate_value> to move string, e.g., F2000
        move_command_str += " " + PARAM_F + str(feed_rate_value)   
    
    # Remove excess whitespace on ends
    move_command_str = move_command_str.strip(" ")
    return move_command_str
# rint(e_value)

############################################
############################################
############################################
    
''' Here's the main method of the script that uses the helper methods above '''

def generate_gcode():

    # [TODO]: Implement the algorithm to generate gcode for each layer by 
    # first to moveing to the layer height, then moving to each line segment.
    # Once at a line segment, you should move and extrude along it, 
    # then move (travel) to the next line until there are no lines left
    # For each of these movements, you should append the command to
    # the list: `all_move_commands`
    current_position = [0, 0, 0]        # start extruder at the origin
    all_move_commands = []              # list to hold for all the move commands

    for i in range(0, len(lines)):
        # Get pts of the line segment
        line = lines[i]
        line_start_position = line.From
        line_end_position = line.To
        #??? do we need a "should_extrude = true/false"???
        # [TODO]: Handle moving to the next layer (Z Position)
        # NOTE- ALL Z MOVEMENTS SHOULD:
        # 1) BE INDEPENDENT MOVES(e.g., G1 Z# and not move with other positions like XYE) 
        # 2) USE THE `layer_change_feed_rate`
        # 3) BE IN INCREASING ORDER
        if current_position[2] != line_start_position[2]:
            move_to_correct_z_layer = gcode_move(current_position, [current_position[0], current_position[1], line_start_position[2]], feed_rate=layer_change_feed_rate)
            all_move_commands.append(move_to_correct_z_layer)
            current_position[2] = line_start_position[2]

        # Now if our current_position is not the start of our line segment
        # we need to move (travel) to the line segment's starting point
        if not is_same_pt(current_position, line_start_position):
            # [Move to the the line_start_position
            move_to_line_start_command = gcode_move(current_position, line_start_position, feed_rate=travel_feed_rate)
            # Append command
            all_move_commands.append(move_to_line_start_command)
            current_position = line_start_position
        
        # [TODO]: Once our extruder is at the start of the line, create a 
        # command to move AND extrude along 
        # the line segment using `extrusion_feed_rate`
        #??? I do not see where the e-value is being used. I imagined something like extrusion_length = e-value to be in the original parameters of the function???
        
        move_extrude_command = gcode_move(current_position, line_end_position, feed_rate=extrusion_feed_rate, should_extrude=True)

        # [TODO]: Append the move command across the line segment 
        all_move_commands.append(move_extrude_command)
        
        # [TODO]: Update the current position of our extruder to be at the end of the line
        current_position = line_end_position
        
    # End of for-loop above -- now create the full set of commands


    # [X][TODO]: Once you have all of the move commands stored as a list in
    # `all_move_commands`, combine the `start_gcode_lines`, `all_move_commands`, and `end_gcode_lines`
    # into one list called `gcode_lines`   
    # gcode_lines = [] 
        gcode_lines = start_gcode_lines + all_move_commands + end_gcode_lines


    # --- DO NOT EDIT BELOW ----
    # The takes the combined gcode_lines list and creates a string containing each line
    # separated by a COMMAND_DELIMITER (the new-line character), and sets it 
    # to the `gcode_output`variable of this component
    output = COMMAND_DELIMITER.join(gcode_lines)
    
    return output
print(gcode_move)
print(generate_gcode) 
# print(e_value) panel
''' RUN THE MAIN FUNCITON ABOVE - DO NOT EDIT '''
# this sets the gcode commands to be the the `gcode_output` variable of this grasshopper component
gcode_output = generate_gcode()
# ---------- end python_3_script_generate_gcode ----------
debugging_panel = Panel(python_3_script_generate_gcode.out)
# [TODO]: Use Pancake Plug-in to Export Gcode Output File as .gcode
the_gcode_output = Panel(python_3_script_generate_gcode.gcode_output)
export_txt = ExportTXT(
    Content=python_3_script_generate_gcode.gcode_output,
    FileLocation="/Users/kristenjacob/Desktop/JACOB_KRISTEN_output4.gcode",
    Overwrite=Toggle(True),
    Encoding="utf-8",
    Export=true_only_button,
    LastSaveLocalization="neutral,N")
panel_8 = Panel(export_txt)
