# Grasshopper definition CF Final - 3D Object with 2D Panels.gh (Grasshopper 1.0.8)
# plug-ins: LunchBox

# ---- group: Create Basic Equilateral Triangle with 3 Holes
xy_plane = XYPlane(Origin=Point(0, 0, 0))
polygon = Polygon(Plane=xy_plane, Radius=Slider(17, range=0..30), Segments=Slider(3, range=0..10), FilletRadius=0)  # -> Polygon, Length
area = Area(Geometry=polygon.Polygon)  # -> Area, Centroid
deconstruct_brep = DeconstructBrep(Brep=polygon.Polygon)  # -> Faces, Edges, Vertices
line = Line(StartPoint=area.Centroid, EndPoint=deconstruct_brep.Vertices)
point_on_curve = PointOnCurve(line, parameter=0.75)
circle = Circle(Plane=point_on_curve, Radius=Slider(1, range=0..10))
merge = Merge(Data1=circle, Data2=polygon.Polygon)
region_union = RegionUnion(Curves=merge)
boundary_surfaces = BoundarySurfaces(Edges=region_union)

# ---- group: Create a Voronoi Pattern on Triangle Faces
number_slider = Slider(6, range=1..30)
rectangle = Rectangle(Plane=PlaneXY(0, 0, 0), XSize=number_slider, YSize=number_slider, Radius=0)  # -> Rectangle, Length
boundary_surfaces_2 = BoundarySurfaces(Edges=rectangle.Rectangle)
area_2 = Area(Geometry=rectangle.Rectangle)  # -> Area, Centroid
number_slider_2 = Slider(26, range=1..30)
polygon_2 = Polygon(Plane=PlaneXY(0, 0, 0), Radius=Slider(10, range=1..20), Segments=Slider(3, range=0..10), FilletRadius=0)  # -> Polygon, Length
populate_2d = Populate2D(Region=boundary_surfaces_2, Count=Slider(40, range=0..100), Seed=Slider(19, range=1..40))
area_3 = Area(Geometry=polygon_2.Polygon)  # -> Area, Centroid
deconstruct_brep_2 = DeconstructBrep(Brep=polygon_2.Polygon)  # -> Faces, Edges, Vertices
voronoi = Voronoi(Points=populate_2d, BruteForceOverride=False)
line_2 = Line(StartPoint=area_3.Centroid, EndPoint=deconstruct_brep_2.Vertices)
scale = Scale(Geometry=voronoi, Center=populate_2d, Factor=Slider(0.4, range=0..1))  # -> Geometry, Transform
point_on_curve_2 = PointOnCurve(line_2, parameter=0.75)
circle_2 = Circle(Plane=point_on_curve_2, Radius=Slider(0.6, range=0.25..1.25))
merge_2 = Merge(Data1=circle_2, Data2=polygon_2.Polygon)
move = Move(Geometry=merge_2, Motion=area_2.Centroid)  # -> Geometry, Transform
region_intersection = RegionIntersection(CurvesA=scale.Geometry, CurvesB=move.Geometry)
merge_3 = Merge(Data1=region_intersection, Data2=move.Geometry)
region_union_2 = RegionUnion(Curves=merge_3)

# ---- group: Create Icosahedron + Create Planes on Each Face
number_slider_3 = Slider(100, range=0..100)
construct_point = ConstructPoint(XCoordinate=number_slider_3, YCoordinate=number_slider_3, ZCoordinate=0)

# ----
brep = Brep(null)

# ---- group: Create Icosahedron + Create Planes on Each Face
xy_plane_2 = XYPlane(Origin=Point(0, 0, 0))
platonic_icosahedron = PlatonicIcosahedron(Plane=xy_plane_2, Radius=Slider(30, range=1..100), Truncation=0.38198)

# ----
move_2 = Move(Geometry=platonic_icosahedron, Motion=construct_point)  # -> Geometry, Transform

# ---- group: Create Icosahedron + Create Planes on Each Face (continued)
deconstruct_brep_3 = DeconstructBrep(Brep=move_2.Geometry)  # -> Faces, Edges, Vertices
area_4 = Area(Geometry=deconstruct_brep_3.Faces)  # -> Area, Centroid
construct_plane = ConstructPlane(Origin=area_4.Centroid, XAxis=Vector(1, 0, 0), YAxis=Vector(0, 1, 0))
evaluate_surface = EvaluateSurface(Surface=deconstruct_brep_3.Faces, Point=area_4.Centroid)  # -> Point, Normal, UDirection, VDirection, Frame
plane_normal = PlaneNormal(Origin=construct_plane, ZAxis=evaluate_surface.Normal)
orient = Orient(Geometry=brep, Source=PlaneXY(0, 0, 0), Target=plane_normal)  # -> Geometry, Transform

# ---- group: Orient Shapes Flat on XY Plane for Laser Cutting
unit_x = UnitX(Factor=1)
series = Series(Start=Slider(0, range=0..100), Step=Slider(31, range=0..300), Count=Slider(20, range=0..100))
xy_plane_3 = XYPlane(Origin=Point(0, 0, 0))
multiplication = Multiplication(A=unit_x, B=series)
move_3 = Move(Geometry=xy_plane_3, Motion=multiplication)  # -> Geometry, Transform
orient_2 = Orient(Geometry=orient.Geometry, Source=plane_normal, Target=move_3.Geometry)  # -> Geometry, Transform
