# Grasshopper definition Parametrically Designed Vases.gh (Grasshopper 1.0.8)

# ---- group: Set Object Height and Direction
height = Slider(30, range=1..30)
construct_point = ConstructPoint(XCoordinate=0, YCoordinate=0, ZCoordinate=0)
line_sdl = LineSDL(Start=construct_point, Direction=Vector(0, 0, 1), Length=height)
segments = Slider(29, range=0..100)
divide_curve = DivideCurve(Curve=line_sdl, Count=segments, Kinks=False)  # -> Points, Tangents, Parameters

# ----
range = Range(Domain=Domain(0, 1), Steps=height)

# ---- group: Tunable Curves
width = Slider(21, range=0..100)
graph_mapper = GraphMapper(
    range,
    x0=0,
    x1=1,
    y0=0,
    y1=1,
    amplitude=0.3,
    container_name="Perlin",
    decay=0.3,
    frequency=0.2641358376,
    x_offset=0.5,
    y_offset=0.5)
multiplication = Multiplication(A=graph_mapper, B=width)

# ---- group: Kind of Polygon
sides_polygon = Slider(8, range=1..9)
curviness = Slider(3.985, range=0..5)
polygon = Polygon(Plane=divide_curve.Points, Radius=multiplication, Segments=sides_polygon, FilletRadius=curviness)  # -> Polygon, Length

# ---- group: Taper
taper_factor = Slider(0.7, range=0.5..2)
scale_nu = ScaleNU(Geometry=polygon.Polygon, Plane=PlaneXY(0, 0, 0), ScaleX=taper_factor, ScaleY=taper_factor, ScaleZ=1)  # -> Geometry, Transform

# ---- group: Tunable Rotation
space_between_each_rotatable_slice = Slider(55, range=1..360)
rotatable_slices = Slider(4, range=1..8)
start_rotation = Slider(1.5, range=0.1..2)
series = Series(Start=start_rotation, Step=space_between_each_rotatable_slice, Count=rotatable_slices)
rotate = Rotate(Geometry=polygon.Polygon, Angle=series, Plane=PlaneXY(0, 0, 0))  # -> Geometry, Transform

# ---- group: Create Object
loft = Loft(Curves=rotate.Geometry, Options={Adjust=False, Closed=False, LoftEnds=0, LoftSimp=0, LoftType=0, Rebuild=10, Refit=0.01})
cap_holes = CapHoles(Brep=loft)
brep = Brep(cap_holes)
