# Grasshopper definition Parametrically Sliced and Numbered.gh (Grasshopper 1.0.8)

# ---- group: Brep Plane to Slice 3D Object -> 2D
material_thickness = Slider(3, range=1..8)
height_of_object = Slider(85, range=1..100)
division = Division(A=height_of_object, B=material_thickness)
series = Series(Start=0, Step=material_thickness, Count=division)
brep = Brep(<brep referenced from the Rhino model>)
construct_point = ConstructPoint(XCoordinate=0, YCoordinate=0, ZCoordinate=series)
construct_plane = ConstructPlane(Origin=construct_point, XAxis=Vector(1, 0, 0), YAxis=Vector(0, 1, 0))
brep_plane = BrepPlane(Brep=brep, Plane=construct_plane)  # -> Curves, Points

# ---- group: Flatten Slices onto the XY Plane
flatten_tree = FlattenTree(Tree=brep_plane.Curves, Path="{0}")
brep_2 = Brep(flatten_tree)
area = Area(Geometry=brep_2)  # -> Area, Centroid
deconstruct = Deconstruct(Point=area.Centroid)  # -> XComponent, YComponent, ZComponent
negative = Negative(Value=deconstruct.ZComponent)
unit_z = UnitZ(Factor=negative)
move = Move(Geometry=brep_2, Motion=unit_z)  # -> Geometry, Transform

# ---- group: Space Along X Axis by Length of Bounding Box
brep_3 = Brep(move.Geometry)
bounding_box = BoundingBox(Content=brep_3, Plane=PlaneXY(0, 0, 0))  # -> Box, Box_2
deconstruct_brep = DeconstructBrep(Brep=bounding_box.Box)  # -> Faces, Edges, Vertices
list_item = ListItem(List=deconstruct_brep.Edges, Index=0, Wrap=True)
number = Number(list_item)
mass_addition = MassAddition(Input=flatten(number))  # -> Result, PartialResults
unit_x = UnitX(Factor=mass_addition.PartialResults)

# ---- group: Create Number Count from 1 +
increment_number_by_1 = Slider(1, range=0..1)
first_number = Slider(10, range=0..100)
series_2 = Series(Start=first_number, Step=increment_number_by_1, Count=division)
text = Text(series_2)

# ---- group: Find Centroid And Move on X Plane with Padding
padding = Slider(6, range=0..10)
move_2 = Move(Geometry=brep_3, Motion=unit_x)  # -> Geometry, Transform
area_2 = Area(Geometry=move_2.Geometry)  # -> Area, Centroid
unit_x_2 = UnitX(Factor=padding)
move_3 = Move(Geometry=area_2.Centroid, Motion=unit_x_2)  # -> Geometry, Transform
line = Line(StartPoint=area_2.Centroid, EndPoint=move_3.Geometry)

# ---- group: Place Text on Surface
height = Slider(7, range=1..10)
text_on_surface = TextOnSurface(Text=text, Font="Sans Bold:no Italic:no", Height=height, Depth=0.4, BaseLine=line, BaseSurface=move_2.Geometry)
