# Grasshopper definition parametricallyDesignedTable.gh (Grasshopper 1.0.8)

# ---- group: Create Voronoi Pattern
radius = Slider(22, range=0..40)
xy_plane = XYPlane(Origin=Point(0, 0, 0))
circle = Circle(Plane=xy_plane, Radius=radius)
brep_wireframe = BrepWireframe(Brep=circle, Density=-1)
join_curves = JoinCurves(Curves=brep_wireframe, Preserve=False)
populate_3d = Populate3D(Region=circle, Count=Slider(68, range=1..80), Seed=Slider(1, range=1..30))
width_of_voronoi_cells = Slider(0.7, range=0..1)
voronoi = Voronoi(Points=populate_3d, Boundary=join_curves, Plane=circle, BruteForceOverride=False)
scale = Scale(Geometry=voronoi, Center=populate_3d, Factor=width_of_voronoi_cells)  # -> Geometry, Transform

# ---- group: Extrude Pattern To Form Table Top
height_of_table_top = Slider(6, range=0..10)
unit_z = UnitZ(Factor=height_of_table_top)
extrude = Extrude(Base=scale.Geometry, Direction=unit_z)
cap_holes = CapHoles(Brep=extrude)
unit_z_2 = UnitZ(Factor=Slider(3, range=0..10))
move = Move(Geometry=cap_holes, Motion=unit_z_2)  # -> Geometry, Transform

# ---- group: Outer Rim of Table Top
tabletop_size = Slider(29, range=0..40)
height_of_the_base_circle_plate = Slider(1, range=0..10)
xy_plane_2 = XYPlane(Origin=Point(0, 0, 0))
width_of_base_circle_plate = Slider(4, range=1..70)
circle_2 = Circle(Plane=xy_plane_2, Radius=tabletop_size)
circle_3 = Circle(Plane=PlaneXY(0, 0, 0), Radius=tabletop_size)
unit_z_3 = UnitZ(Factor=height_of_the_base_circle_plate)
unit_z_4 = UnitZ(Factor=width_of_base_circle_plate)
extrude_2 = Extrude(Base=circle_2, Direction=unit_z_4)
extrude_3 = Extrude(Base=circle_3, Direction=unit_z_3)
cap_holes_2 = CapHoles(Brep=extrude_2)
cap_holes_3 = CapHoles(Brep=extrude_3)

# ---- group: Join Objects + Move to The Table Height
solid_difference = SolidDifference(BrepsA=cap_holes_2, BrepsB=move.Geometry)
table_height = Slider(9, range=1..40)
move_2 = Move(Geometry=solid_difference, Motion=unit_z_3)  # -> Geometry, Transform
merge = Merge(Data1=move_2.Geometry, Data2=cap_holes_3)
brep_join = BrepJoin(Breps=merge)  # -> Breps, Closed
unit_z_5 = UnitZ(Factor=table_height)
move_3 = Move(Geometry=brep_join.Breps, Motion=unit_z_5)  # -> Geometry, Transform

# ---- group: Make An Interesting Base
construct_point = ConstructPoint(XCoordinate=0, YCoordinate=0, ZCoordinate=0)
number_slider = Slider(9, range=1..20)
line_sdl = LineSDL(Start=construct_point, Direction=Vector(0, 0, 1), Length=table_height)
range = Range(Domain=Domain(0, 1), Steps=number_slider)
divide_curve = DivideCurve(Curve=line_sdl, Count=number_slider, Kinks=False)  # -> Points, Tangents, Parameters
width = Slider(9, range=1..30)
sides_polygon = Slider(5, range=1..9)
graph_mapper = GraphMapper(range, x0=0, x1=1, y0=0, y1=1, Ox=0.5289855003, Oy=0.1811594367, Px=0.75, Py=0.25, container_name="Parabola")
multiplication = Multiplication(A=graph_mapper, B=width)
polygon = Polygon(Plane=divide_curve.Points, Radius=multiplication, Segments=sides_polygon, FilletRadius=0)  # -> Polygon, Length
rotate = Rotate(Geometry=polygon.Polygon, Angle=Slider(31, range=0..100), Plane=PlaneXY(0, 0, 0))  # -> Geometry, Transform
loft = Loft(Curves=rotate.Geometry, Options={Adjust=False, Closed=False, LoftEnds=0, LoftSimp=0, LoftType=0, Rebuild=10, Refit=0.01})
cap_holes_4 = CapHoles(Brep=loft)

# ---- group: Join Objects Into One
merge_2 = Merge(Data1=move_3.Geometry, Data2=cap_holes_4)
brep_join_2 = BrepJoin(Breps=merge_2)  # -> Breps, Closed
solid_union = SolidUnion(Breps=brep_join_2.Breps)
